vi "HostMain.gvi"   [LabVIEW Communications System Design Suite 2.0.1]
panel controls:
  "RIO address": string = "RIO0"
  "stop": bool
  "HostParam": i32 = 5
panel indicators:
  "output": i32[]
  "input": i32
diagram:
  FPGA Open Node[ProjectItem=":NullTarget:USRP\\-SharedFifos\\-0001\\.lvbitx"](RIO address=$"RIO address", error in=no error, run?=TRUE) -> (error out=w1, reference out=w2)
  FPGA Download Node(error in=w1, reference in=w2) -> (error out=w3, reference out=w4)
  FPGA Run Node(error in=w3, reference in=w4) -> (error out=w5, reference out=w6)
  Host Fifo Configure Node[FifoName="Resources.grsc\\H2T_1"](depth=10000, error in=w5, reference in=w6) -> (error out=w7, reference out=w8)
  Host Fifo Start Node[FifoName="Resources.grsc\\H2T_1"](error in=w7, reference in=w8) -> (error out=w9, reference out=w10)
  Host Fifo Configure Node[FifoName="Resources.grsc\\T2H_1"](depth=10000, error in=w9, reference in=w10) -> (error out=w11, reference out=w12)
  Host Fifo Start Node[FifoName="Resources.grsc\\T2H_1"](error in=w11, reference in=w12) -> (error out=w13, reference out=w14)
  call "Display Error.gvi"(error in=w13)
  case (w13) {
    frame Error { }
    frame No Error {
      s1 = 0  # shift register
      while {
        $input <- s1
        Add(1, s1) -> w15
        Initialize Array(element=s1, size=10) -> w16
        Host Fifo Write Node[FifoName="Resources.grsc\\H2T_1"](data=w16, error in=w13, reference in=w14) -> (error out=w17, reference out=w18)
        Array Size(array=w16) -> (size(s)=w19)
        Host Fifo Read Node[FifoName="Resources.grsc\\T2H_1"](error in=w17, number of elements=w19, reference in=w18) -> (data=w20)
        $output <- w20
        Property Node(instance in=w14, "HostParam"=$HostParam)
        Wait(time to wait=100)
        next s1 = w15
        stop if $stop
      }
    }
  }
