vi "Toplevel.gvi"   [LabVIEW Communications System Design Suite 2.0.1]
panel controls:
  "HostParam": i32
diagram:
  clock-driven loop (clock = "40 MHz Onboard Clock") forever {
    Feedback Node(input=w1) -> w2
    FIFO Read(Control Protocol Input=w2, reference in="Resources.grsc\\H2T_1") -> (Control Protocol Output=w3, data=w4)
    Add($HostParam, w4) -> w5
    FIFO Write(Control Protocol Input=w3, data=w5, reference in="Resources.grsc\\T2H_1") -> (Control Protocol Output=w1)
    Feedback Node(input=w6) -> w7
    FIFO Read(Control Protocol Input=w7, reference in="Resources.grsc\\H2T_2") -> (Control Protocol Output=w8, data=w9)
    Multiply($HostParam, w9) -> w10
    FIFO Write(Control Protocol Input=w8, data=w10, reference in="Resources.grsc\\T2H_2") -> (Control Protocol Output=w6)
  }
